# Dynamo graph room_extractor_v1.0.dyn "RoomExport_v1.0" (Dynamo 2.12.1.8246)

file_path = Filename("C:\Users\hdong\OneDrive - EwingCole\Desktop\CSV ROOM DATA\2019035 Wake Eye Institute\room_data_extract_raw.csv")
categories = Categories("OST_Rooms")
all_elements_of_category = ElementsOfCategory(Category=categories)
code_block = CodeBlock { "Level"; "Name"; "Area (SF)"; "Room Category"; "Room Type Description"; }
getParameterValueByName = Element.GetParameterValueByName(element=all_elements_of_category, parameterName=code_block.out0)
getParameterValueByName_2 = Element.GetParameterValueByName(element=all_elements_of_category, parameterName=code_block.out1)
getParameterValueByName_3 = Element.GetParameterValueByName(element=all_elements_of_category, parameterName=code_block.out2)
getParameterValueByName_4 = Element.GetParameterValueByName(element=all_elements_of_category, parameterName=code_block.out3)
getParameterValueByName_5 = Element.GetParameterValueByName(element=all_elements_of_category, parameterName=code_block.out4)
list_create = List.Create(item0=getParameterValueByName, item1=getParameterValueByName_2, item2=getParameterValueByName_3, item3=getParameterValueByName_4, item4=getParameterValueByName_5)
transpose = List.Transpose(lists=list_create)
exportCSV = Data.ExportCSV(filePath=file_path, data=transpose)
file_path_2 = Filename(".\room_data_extract_raw.xlsx")
code_block_2 = CodeBlock { "Room Data"; 1; }
boolean = BoolSelector(true)
exportToExcel = Data.ExportToExcel(filePath=file_path_2, sheetName=code_block_2.out0, startRow=code_block_2.out1, startColumn=code_block_2.out1, data=transpose, overWrite=boolean)
